# Grasshopper definition speckel_fetchMatrices.gh (Grasshopper 1.0.7)
# plug-ins: Speckle 2

# speckle convention for distance/trip matrice:
# Matrices are storend in a json string on speckle that has the follwoing format:
# {
#     "destination_uuid":[],
#     "origin_uuid":[],
#     "matrix":[[],[]],
#     "logs":{}
# }
path_to_matrtices = Panel("https://speckle.xyz/streams/ebcfc50abe/branches/graph_geometry%2Fdistance_matrix")
receive = Receive(
    Stream=path_to_matrtices,
    AutoReceive=False,
    CurrentComponentState="expired",
    ExpandOutput=True,
    LastInfoMessage="Joscha During @ 01/25/2024 18:11:19: !!! matrices renamed, all new incl ped and art (id:94494f545d)",
    ReceiveOnOpen=False,
    ReceivedCommitId="94494f545d",
    StreamWrapper="https://speckle.xyz/streams/ebcfc50abe/branches/graph_geometry/distance_matrix",
    selectedKitName="Objects")  # -> Info, Data
deconstruct_speckle_object = DeconstructSpeckleObject(SpeckleObject=receive.Data, selectedKitName="None")  # -> flatten(Activity_nodeDistance_matrix_ped_art_noEntr), flatten(Activity_nodeDistance_matrix_ped_mm_art_noEntr), flatten(Activity_nodeDistance_matrix_ped_mm_noEntr), flatten(Activity_nodeDistance_matrix_ped_noEntr)
ghpython_script = GhPythonScript(speckelMatrix=deconstruct_speckle_object.Activity_nodeDistance_matrix_ped_art_noEntr)  # -> matrix
# ---------- ghpython_script: Python ----------
__author__ = "Serjoscha Duering"
__version__ = "2024.01.25"

import rhinoscriptsyntax as rs
import json 

import Grasshopper
import ghpythonlib.treehelpers as th
import ghpythonlib.parallel as pr
import Rhino.Geometry.Matrix as Matrix 


"""
speckle convention:
Matrices are storend in a json string on speckle that has the follwoing format:
{
    "destination_uuid":[], 
    "origin_uuid":[],
    "matrix":[[],[]]
}
"""

# load json string, transform to dictionary 
matrixDict = json.loads(speckelMatrix)
print (matrixDict.keys())


def nested_list_to_matrix(nested_list):
    num_rows = len(nested_list)
    num_cols = len(nested_list[0])
    matrix = Matrix(num_rows, num_cols)
    for i in range(num_rows):
        for j in range(num_cols):
            matrix[i, j] = nested_list[i][j]

    return matrix
    

# Convert the nested list to the matrix template
matrix = nested_list_to_matrix(matrixDict["matrix"])
# ---------- end ghpython_script ----------
panel = Panel("https://speckle.xyz/streams/ebcfc50abe/branches/graph_geometry%2Fdistance_matrix")
receive_2 = Receive(
    Stream=panel,
    AutoReceive=False,
    CurrentComponentState="expired",
    ExpandOutput=True,
    LastInfoMessage="Joscha During @ 01/25/2024 18:11:19: !!! matrices renamed, all new incl ped and art (id:94494f545d)",
    ReceiveOnOpen=False,
    ReceivedCommitId="94494f545d",
    StreamWrapper="https://speckle.xyz/streams/ebcfc50abe/branches/graph_geometry/distance_matrix",
    selectedKitName="Objects")  # -> Info, Data
deconstruct_speckle_object_2 = DeconstructSpeckleObject(SpeckleObject=receive_2.Data, selectedKitName="None")  # -> flatten(Activity_nodeDistance_matrix_ped_art_noEntr), flatten(Activity_nodeDistance_matrix_ped_mm_art_noEntr), flatten(Activity_nodeDistance_matrix_ped_mm_noEntr), flatten(Activity_nodeDistance_matrix_ped_noEntr)
ghpython_script_2 = GhPythonScript(speckelMatrix=deconstruct_speckle_object_2.Activity_nodeDistance_matrix_ped_mm_noEntr)  # -> matrix; same code as ghpython_script
ghpython_script_3 = GhPythonScript(speckelMatrix=deconstruct_speckle_object_2.Activity_nodeDistance_matrix_ped_art_noEntr)  # -> matrix; same code as ghpython_script
ghpython_script_4 = GhPythonScript(speckelMatrix=deconstruct_speckle_object_2.Activity_nodeDistance_matrix_ped_mm_art_noEntr)  # -> matrix; same code as ghpython_script
ghpython_script_5 = GhPythonScript(speckelMatrix=deconstruct_speckle_object_2.Activity_nodeDistance_matrix_ped_noEntr)  # -> matrix; same code as ghpython_script
